# Grasshopper definition honeycomb.gh (Grasshopper 0.9.80)
# plug-ins: IntraLattice

list = ValueList({"Grid": 0, "X": 1, "Star": 2, "Cross": 3, "Tesseract": 4, "Vintiles": 5, "Octet": 6, "Diamond": 7, "Honeycomb 1": 8, "Honeycomb 2": 9}, selected="Honeycomb 2")
preset_cell = PresetCell(CellTye=list)  # -> Topology, Lines
basic_cylinder = BasicCylinder(Topology=preset_cell.Topology, Radius=10, Height=10, NumberU=2, NumberV=10, NumberW=2, Morph=False)
homogen = Homogen(Struts=basic_cylinder, Radius=0.25)
